# Grasshopper definition test.gh (Grasshopper 1.0.7)
# plug-ins: Hops

panel = Panel("C:\Users\nshikada\Documents\GitHub\firebaseRealtimeGH\keys\firebase_table-key.json")
hops = Hops(
    Url="https://magpietable-default-rtdb.firebaseio.com/",
    Credentials_path=panel,
    CacheResultsInMemory=True,
    CacheSolveResults=True,
    RemoteDefinitionLocation="http://127.0.0.1:5000/listen_to_firebase",
    RemoteSolveVersion=(0, 1, 0),
    ShowInput_Enabled=False,
    ShowInput_Path=False,
    SynchronousSolve=True)
panel_2 = Panel(hops)
